# Grasshopper definition CPython_GHPython.gh (Grasshopper 1.0.7)
# plug-ins: GH_CPython

gh_cpython = GH_CPython(input=0)  # -> output, myList, myStringList; inputs input: list
#   port input: [required] - [type = int] - [default = None] Descripe your input here * bullet point. * bullet point
#   port output: indicate your output description here. refers to a new line.
# ---------- gh_cpython: Python ----------
myList = []
for i in range(10):
    myList.append([i,i,i])

myStringList = []
for item in myList:
    itemString  = str(item[0]) + '-' + str(item[1]) + '-' + str(item[2])
    print(itemString)
    myStringList.append(itemString)

print(myStringList)
# ---------- end gh_cpython ----------
python = GhPythonScript(myStringList=gh_cpython.myStringList)  # -> out, myPointList; inputs myStringList: list
# ---------- python: Python ----------
import rhinoscriptsyntax as rs
import Rhino.Geometry as rg

myPointList = []
for i in range(len(myStringList)):
    rawItem = myStringList[i]
    if i==0:item = rawItem[1:-1]
    else:item = rawItem[2:-1]
    
    stringItems  = item.split('-')
    floatItems = [float(str) for str in stringItems]
    vector = rg.Point3d(floatItems[0],floatItems[2],floatItems[2])
    myPointList.append(vector)
    
print(myPointList)
# ---------- end python ----------
python_2 = GhPythonScript(myList=gh_cpython.myList)  # -> out, myPointList; inputs myList: list
# ---------- python_2: Python ----------
import rhinoscriptsyntax as rs
import Rhino.Geometry as rg

myPointList = []
for j in range(int(len(myList)/3)):
    floatItems = []
    for k in range(3):
        i = j*3 + k
        
        rawItem = myList[i]
        if i==0:item = rawItem
        else:item = rawItem[1:]
        
        
        floatItems.append(float(item)) 
    vector = rg.Point3d(floatItems[0],floatItems[2],floatItems[2])
    myPointList.append(vector)
    
print(myPointList)
# ---------- end python_2 ----------
panel = Panel(python_2.myPointList)
panel_2 = Panel(python.myPointList)
