# Grasshopper definition Graph Relaxation_Py3.gh (Grasshopper 1.0.7)
# plug-ins: GH_CPython

nr_of_iterations = Slider(56, range=0..100)
damping_coefficient = Slider(2, range=0..10)
elasticity_constant = Slider(10, range=0..100)
initial_radius = Slider(36, range=0..100)
number_slider = Slider(2, range=0..10)
relations_csv = FilePath("C:\Users\pnourian\surfdrive\Spatial_Computation\Minor_Spatial_Computing\SampleData_Relation.csv")
spaces_csv = FilePath("C:\Users\pnourian\surfdrive\Spatial_Computation\Minor_Spatial_Computing\SampleData_Spaces.csv")
pt = Point(Point(-18, 0.7943493413, 0))
path_spaces = FilePath("C:\New folder\SampleData_Spaces.csv")
path_relations = FilePath("C:\New folder\SampleData_Relation.csv")
gh_cpython = GH_CPython(
    input=number_slider,
    NumberOfIterations=nr_of_iterations,
    Damping=damping_coefficient,
    Radius=initial_radius,
    ElasticityConstant=elasticity_constant)  # -> output, SpaceNames, SpaceAreas, SpaceCentroid, Relations_A, Relations_B; inputs input: list, NumberOfIterations: list, Damping: list, Radius: list, ElasticityConstant: list
#   port input: [required] - [type = int] - [default = None] Descripe your input here * bullet point. * bullet point
#   port output: indicate your output description here. refers to a new line.
# ---------- gh_cpython: Python ----------
### Dynamic Relaxation
###  
### Developed by Shervin Azadi, Edited by Pirouz Nourian on 10/Sep/2018
### Last edited by Puck Flikweert on 07/Dec/2018
###
### Thanks to Ir. Dirk Rinze Visser for introducing the following book chapter, which forms the basis of this algorithm: 
### Adriaenssens, S., P. Block, D. Veenendaal, and C. Williams (2014). Shell Structures for Architecture: Form Finding and Optimization. New York: Routledge.
### "Chapter 2: Review of Dynamic Relaxation with an extension to six degrees of freedom theory" by Adriaenssens
### Inspired by the algorithm Force-Directed Bubble Diagrama Drawing from:
### Configraphics: Graph Theoretical Methods for Design and Analysis of Spatial Configurations, P Nourian, A+ BE: Architecture and the Built Environment 6 (14), 1-348
### 

"""
Modified BSD 3-Clause License

Copyright (c) 2018, Shervin Azadi, Pirouz Nourian & Puck Flikweert
All rights reserved.

Commerical or Academic use is permitted provided the work is adequately cited and attributed to the author. This work can be cited as follows:

Azadi, Shervin, Nourian, Pirouz, Flikweert, Puck, Force-Directed Graph Drawing using Dynamic Relaxation, 2018, avaiable at https://gitlab.com/Pirouz-Nourian/spatial_computing


Redistribution and use in source and binary forms, with or without
modification, are permitted provided that the following conditions are met:

* Redistributions of source code must retain the above copyright notice, this
  list of conditions and the following disclaimer.

* Redistributions in binary form must reproduce the above copyright notice,
  this list of conditions and the following disclaimer in the documentation
  and/or other materials provided with the distribution.

* Neither the name of the copyright holder nor the names of its
  contributors may be used to endorse or promote products derived from
  this software without specific prior written permission.

THIS SOFTWARE IS PROVIDED BY THE COPYRIGHT HOLDERS AND CONTRIBUTORS "AS IS"
AND ANY EXPRESS OR IMPLIED WARRANTIES, INCLUDING, BUT NOT LIMITED TO, THE
IMPLIED WARRANTIES OF MERCHANTABILITY AND FITNESS FOR A PARTICULAR PURPOSE ARE
DISCLAIMED. IN NO EVENT SHALL THE COPYRIGHT HOLDER OR CONTRIBUTORS BE LIABLE
FOR ANY DIRECT, INDIRECT, INCIDENTAL, SPECIAL, EXEMPLARY, OR CONSEQUENTIAL
DAMAGES (INCLUDING, BUT NOT LIMITED TO, PROCUREMENT OF SUBSTITUTE GOODS OR
SERVICES; LOSS OF USE, DATA, OR PROFITS; OR BUSINESS INTERRUPTION) HOWEVER
CAUSED AND ON ANY THEORY OF LIABILITY, WHETHER IN CONTRACT, STRICT LIABILITY,
OR TORT (INCLUDING NEGLIGENCE OR OTHERWISE) ARISING IN ANY WAY OUT OF THE USE
OF THIS SOFTWARE, EVEN IF ADVISED OF THE POSSIBILITY OF SUCH DAMAGE.

"""
### 
#####################################################

import copy
import csv
import math

#Input data:
# -----------

RelationCSV = "C:\\Users\\pnourian\\surfdrive\\Spatial_Computation\\Minor_Spatial_Computing\\SampleData_Relation_Py3.csv"#relations_csv_path
# opening the file
with open(RelationCSV, 'rt') as csvfile:
     reader = csv.reader(csvfile, delimiter=',', quotechar='|')
     reldata = [row for row in reader]
     # relations: startspace:int, endspace:int, weight:float
     relations = [(int(row[0]), int(row[1]), float(row[2])) for row in reldata[1:]]
     

SpacesCSV = "C:\\Users\\pnourian\\surfdrive\\Spatial_Computation\\Minor_Spatial_Computing\\SampleData_Spaces_Py3.csv"#spaces_csv_path
# opening the file
with open(SpacesCSV, 'rt') as csvfile:
     reader2 = csv.reader(csvfile, delimiter=',', quotechar='|')
     spacedata = [row for row in reader2]
     # spaces : name:string, id:int, area:int
     spaces = [(row[0], int(row[1]), int(row[2])) for row in spacedata[1:]]  

# initiating the lists
xyz = []  # xyz coordinates


#placement around the circle
rad = int(Radius)
spacecount = len(spaces)
for i in range(spacecount):
    pos = (rad * math.cos(2*math.pi * i/spacecount), rad * math.sin(2*math.pi * i/spacecount), 0)
    xyz.append(pos)

bbmax = [0,0,0]
bbmin = [0,0,0]
for i, x in enumerate(iter(xyz)):
    #finding the bounding box
    for i in range(3):
        if x[i] > bbmax[i]: bbmax[i] = x[i]
        if x[i] < bbmin[i]: bbmin[i] = x[i]

# reserving the Initial State of the system
xyzIS = copy.deepcopy(xyz)

# Output data:
# -----------
# spaces : List of spaces
# relations : List of relations
# xyz : coordination of centroid of spaces
# xyzIS : Initial state of the system
# bbmax, bbmin : Bounding Box

#####################################################
###
### Dynamic Relaxation
###
#####################################################

from numpy import array, zeros, float64, sqrt
import numpy as np
import copy

# Input data:
# -----------
# spaces : List of spaces
# relations : List of relations
# xyz : coordination of centroid of spaces
# bbmax, bbmin : Bounding Box

m = len(relations)
n = len(spaces)

# initializing the repulsion relations
repulseRel = []
for i in range(n):
    for j in range(n):
        if i<j:
            repulseRel.append(tuple([i,j]))

o = len(repulseRel)

# p : Applied Load Component which in our case is zero
p = zeros((n, 3), dtype=float64)
# v : Velosity
v = zeros((n, 3), dtype=float64)
# restlength : Rest Length of the relations
restlength = array([(sqrt(spaces[relations[i][1]][2]) + sqrt(spaces[relations[i][0]][2])) for i in range(m)])
# repulslength : threshold of repulsion
repulslength = array([(sqrt(spaces[repulseRel[i][1]][2]) + sqrt(spaces[repulseRel[i][0]][2])) for i in range(o)])

# adamp : Acceleration damp controls the stability of the system
adamp = Damping
IterationMax = int(NumberOfIterations)
# K : Elasticity Constant in Hooke's law
K = ElasticityConstant
# dt : Time intervals
dt = 0.1
mass = 1

for k in range(IterationMax):
    # S : Stiffness Force
    S = zeros((n, 3), dtype=float64)
    # R : Final Forces
    R = zeros((n, 3), dtype=float64)
    
    if k%100 == 99 : print ('iteration: ' + str(k))
    # xyz0 : Initial Position
    xyz0 = copy.copy(xyz)
    # vp : Initial Velocity
    vp = v.copy()
    
    # calculating the length of the relations
    di = array([(xyz[relations[i][1]][0] - xyz[relations[i][0]][0],
                 xyz[relations[i][1]][1] - xyz[relations[i][0]][1],
                 xyz[relations[i][1]][2] - xyz[relations[i][0]][2]) for i in range(m)])
    dist = array([sqrt(di[i,0]*di[i,0] + di[i,1]*di[i,1] + di[i,2]*di[i,2]) for i in range(m)])
  
    # Hooke's law : Force = length difference * Elasticity Constant (K)
    EdgeForce = (dist - restlength) * K
    # Edge Force : Decomposing the existing force in each edge into the 3 dimensions 
    EdgeForceS = zeros((m, 3), dtype=float64)

    # iterating throughout the edges
    for i in range(m):
        for j in range(3):
            # Separating the forces into X, Y, Z dimensions
            EdgeForceS[i,j] = (di[i,j] / dist[i]) * EdgeForce[i]

        # Adding the force of each edge to the coresponding nodes
        S[relations[i][0]] -= EdgeForceS[i]
        S[relations[i][1]] += EdgeForceS[i]

    # calculating the length of the repulsion relations
    repdi = array([(xyz[repulseRel[i][1]][0] - xyz[repulseRel[i][0]][0],
                 xyz[repulseRel[i][1]][1] - xyz[repulseRel[i][0]][1],
                 xyz[repulseRel[i][1]][2] - xyz[repulseRel[i][0]][2]) for i in range(o)])
    repdist = array([sqrt(repdi[i,0]*repdi[i,0] + repdi[i,1]*repdi[i,1] + repdi[i,2]*repdi[i,2]) for i in range(o)])  

    # Repulsion Force
    RepForce = ((repdist - repulslength) - abs(repdist - repulslength)) * K * 0.5
    # Edge Force : Decomposing the existing force in each edge into the 3 dimensions 
    RepForceS = zeros((o, 3), dtype=float64)

    # iterating throughout the edges
    for i in range(o):
        for j in range(3):
            # Separating the forces into X, Y, Z dimensions
            RepForceS[i,j] = (repdi[i,j] / repdist[i]) * RepForce[i]

        # Adding the force of each edge to the coresponding nodes
        S[repulseRel[i][0]] -= RepForceS[i]
        S[repulseRel[i][1]] += RepForceS[i]
    
    R = p - S

    A = 1/(1 + adamp * dt * 0.5)
    B = (1 - adamp * dt * 0.5 ) / (1 + adamp * dt * 0.5)
    
    # updating the velocity
    v = A * dt * R / mass + B * vp
    # updating the position
    xyz = xyz0 + dt * v

SpaceNames = [item[0] for item in spaces]
SpaceAreas = [item[2] for item in spaces]
SpaceCentroid = [(str(item[0])+"%"+str(item[1])+"%"+str(item[2])) for item in xyz]
Relations_A = [item[0] for item in relations]
Relations_B = [item[1] for item in relations]
# ---------- end gh_cpython ----------
gh_cpython_2 = GH_CPython(
    input=number_slider,
    NumberOfIterations=nr_of_iterations,
    Damping=damping_coefficient,
    Radius=initial_radius,
    ElasticityConstant=elasticity_constant)  # -> output, SpaceNames, SpaceAreas, SpaceCentroid, Relations_A, Relations_B; inputs input: list, NumberOfIterations: list, Damping: list, Radius: list, ElasticityConstant: list
#   port input: [required] - [type = int] - [default = None] Descripe your input here * bullet point. * bullet point
#   port output: indicate your output description here. refers to a new line.
# ---------- gh_cpython_2: Python ----------
### Dynamic Relaxation
###
### Developed by Shervin Azadi, Edited by Pirouz Nourian on 10/Sep/2018
### Last edited by Puck Flikweert on 07/Dec/2018
###
### Thanks to Ir. Dirk Rinze Visser for introducing the following book chapter, which forms the basis of this algorithm: 
### Adriaenssens, S., P. Block, D. Veenendaal, and C. Williams (2014). Shell Structures for Architecture: Form Finding and Optimization. New York: Routledge.
### "Chapter 2: Review of Dynamic Relaxation with an extension to six degrees of freedom theory" by Adriaenssens
### Inspired by the algorithm Force-Directed Bubble Diagrama Drawing from:
### Configraphics: Graph Theoretical Methods for Design and Analysis of Spatial Configurations, P Nourian, A+ BE: Architecture and the Built Environment 6 (14), 1-348
### 
#####################################################
import copy
import csv
import math

#Input data:
# -----------

RelationCSV = "C:\\Users\\pnourian\\surfdrive\\Spatial_Computation\\Minor_Spatial_Computing\\SampleData_Relation_Py3.csv"#relations_csv_path
# opening the file
with open(RelationCSV, 'rt') as csvfile:
     reader = csv.reader(csvfile, delimiter=',', quotechar='|')
     reldata = [row for row in reader]
     # relations: startspace:int, endspace:int, weight:float
     relations = [(int(row[0]), int(row[1]), float(row[2])) for row in reldata[1:]]
     

SpacesCSV = "C:\\Users\\pnourian\\surfdrive\\Spatial_Computation\\Minor_Spatial_Computing\\SampleData_Spaces_Py3.csv"#spaces_csv_path
# opening the file
with open(SpacesCSV, 'rt') as csvfile:
     reader2 = csv.reader(csvfile, delimiter=',', quotechar='|')
     spacedata = [row for row in reader2]
     # spaces : name:string, id:int, area:int
     spaces = [(row[0], int(row[1]), int(row[2])) for row in spacedata[1:]]  

# initiating the lists
xyz = []  # xyz coordinates


#placement around the circle
rad = int(Radius)
spacecount = len(spaces)
for i in range(spacecount):
    pos = (rad * math.sin(360 * i/spacecount), rad * math.cos(360 * i/spacecount), 0)
    xyz.append(pos)

bbmax = [0,0,0]
bbmin = [0,0,0]
for i, x in enumerate(iter(xyz)):
    #finding the bounding box
    for i in range(3):
        if x[i] > bbmax[i]: bbmax[i] = x[i]
        if x[i] < bbmin[i]: bbmin[i] = x[i]

# reserving the Initial State of the system
xyzIS = copy.deepcopy(xyz)

# Output data:
# -----------
# spaces : List of spaces
# relations : List of relations
# xyz : coordination of centroid of spaces
# xyzIS : Initial state of the system
# bbmax, bbmin : Bounding Box

#####################################################
###
### Dynamic Relaxation
###
#####################################################

from numpy import array, zeros, float64, sqrt
import numpy as np
import copy

# Input data:
# -----------
# spaces : List of spaces
# relations : List of relations
# xyz : coordination of centroid of spaces
# bbmax, bbmin : Bounding Box

m = len(relations)
n = len(spaces)

# initializing the repulsion relations
repulseRel = []
for i in range(n):
    for j in range(n):
        if i<j:
            repulseRel.append(tuple([i,j]))

o = len(repulseRel)

# p : Applied Load Component which in our case is zero
p = zeros((n, 3), dtype=float64)
# v : Velosity
v = zeros((n, 3), dtype=float64)
# restlength : Rest Length of the relations
restlength = array([(sqrt(spaces[relations[i][1]][2]) + sqrt(spaces[relations[i][0]][2])) for i in range(m)])
# repulslength : threshold of repulsion
repulslength = array([(sqrt(spaces[repulseRel[i][1]][2]) + sqrt(spaces[repulseRel[i][0]][2])) for i in range(o)])

# adamp : Acceleration damp controls the stability of the system
adamp = Damping
IterationMax = int(NumberOfIterations)
# K : Elasticity Constant in Hooke's law
K = ElasticityConstant
# dt : Time intervals
dt = 0.1
mass = 1

for k in range(IterationMax):
    # S : Stiffness Force
    S = zeros((n, 3), dtype=float64)
    # R : Final Forces
    R = zeros((n, 3), dtype=float64)
    
    if k%100 == 99 : print ('iteration: ' + str(k))
    # xyz0 : Initial Position
    xyz0 = copy.copy(xyz)
    # vp : Initial Velocity
    vp = v.copy()
    
    # calculating the length of the relations
    di = array([(xyz[relations[i][1]][0] - xyz[relations[i][0]][0],
                 xyz[relations[i][1]][1] - xyz[relations[i][0]][1],
                 xyz[relations[i][1]][2] - xyz[relations[i][0]][2]) for i in range(m)])
    dist = array([sqrt(di[i,0]*di[i,0] + di[i,1]*di[i,1] + di[i,2]*di[i,2]) for i in range(m)])
  
    # Hooke's law : Force = length difference * Elasticity Constant (K)
    EdgeForce = (dist - restlength) * K
    # Edge Force : Decomposing the existing force in each edge into the 3 dimensions 
    EdgeForceS = zeros((m, 3), dtype=float64)

    # iterating throughout the edges
    for i in range(m):
        for j in range(3):
            # Separating the forces into X, Y, Z dimensions
            EdgeForceS[i,j] = (di[i,j] / dist[i]) * EdgeForce[i]

        # Adding the force of each edge to the coresponding nodes
        S[relations[i][0]] -= EdgeForceS[i]
        S[relations[i][1]] += EdgeForceS[i]

    # calculating the length of the repulsion relations
    repdi = array([(xyz[repulseRel[i][1]][0] - xyz[repulseRel[i][0]][0],
                 xyz[repulseRel[i][1]][1] - xyz[repulseRel[i][0]][1],
                 xyz[repulseRel[i][1]][2] - xyz[repulseRel[i][0]][2]) for i in range(o)])
    repdist = array([sqrt(repdi[i,0]*repdi[i,0] + repdi[i,1]*repdi[i,1] + repdi[i,2]*repdi[i,2]) for i in range(o)])  

    # Repulsion Force
    RepForce = ((repdist - repulslength) - abs(repdist - repulslength)) * K * 0.5
    # Edge Force : Decomposing the existing force in each edge into the 3 dimensions 
    RepForceS = zeros((o, 3), dtype=float64)

    # iterating throughout the edges
    for i in range(o):
        for j in range(3):
            # Separating the forces into X, Y, Z dimensions
            RepForceS[i,j] = (repdi[i,j] / repdist[i]) * RepForce[i]

        # Adding the force of each edge to the coresponding nodes
        S[repulseRel[i][0]] -= RepForceS[i]
        S[repulseRel[i][1]] += RepForceS[i]
    
    R = p - S

    A = 1/(1 + adamp * dt * 0.5)
    B = (1 - adamp * dt * 0.5 ) / (1 + adamp * dt * 0.5)
    
    # updating the velocity
    v = A * dt * R / mass + B * vp
    # updating the position
    xyz = xyz0 + dt * v

SpaceNames = [item[0] for item in spaces]
SpaceAreas = [item[2] for item in spaces]
SpaceCentroid = [(str(item[0])+"%"+str(item[1])+"%"+str(item[2])) for item in xyz]
Relations_A = [item[0] for item in relations]
Relations_B = [item[1] for item in relations]
# ---------- end gh_cpython_2 ----------
panel = Panel(gh_cpython_2.output)
python = PythonScript(
    SpaceNames=gh_cpython.SpaceNames,
    SpaceAreas=gh_cpython.SpaceAreas,
    SpaceCentroid=gh_cpython.SpaceCentroid,
    Relations_A=gh_cpython.Relations_A,
    Relations_B=gh_cpython.Relations_B)  # -> Spheres, Lines; inputs SpaceNames: list, SpaceAreas: list, SpaceCentroid: list, Relations_A: list, Relations_B: list
# ---------- python: Python ----------
import Rhino.Geometry as rg
from math import sqrt

centroids = []
areas = []
spheres = []
names = []
# parsing space related attributes
for i in xrange(len(SpaceCentroid)):
    centroid = SpaceCentroid[i].replace(" ",'')
    centroid = centroid[1:-1].split('%')
    centroid = [float(j) for j in centroid]

    npt = rg.Point3d(centroid[0],centroid[1],centroid[2])
    centroids.append(npt)

    area = SpaceAreas[i].replace(" ",'')
    area = float(area)
    areas.append(area)

    ball = rg.Sphere(centroids[i],sqrt(area))
    spheres.append(ball)

    name = SpaceNames[i].replace(" ",'').replace("'",'')
    names.append(name)

relS = []
relE = []
lines = []
# parsing  relation related attributes
for i in xrange(len(Relations_A)):
    rA = Relations_A[i].replace(" ",'')
    relS.append(int(rA))

    rB = Relations_B[i].replace(" ",'')
    relE.append(int(rB))

    line = rg.Line(centroids[int(rA)], centroids[int(rB)])
    lines.append(line)

SpaceCentroids = centroids
SpaceAreas = areas
RelationsStart = relS
RelationsEnd = relE
SpaceNames = names
Spheres = spheres
Lines = lines
# ---------- end python ----------
panel_2 = Panel(gh_cpython.SpaceAreas)
spheres = Data(python.Spheres)
lines = Data(python.Lines)
