# Grasshopper definition dynamic relaxation 1.7.gh (Grasshopper 1.0.7)
# plug-ins: MeshEdit Components, Weaverbird, GH_CPython, Kangaroo2 Components

# ---- group: test_data
S = Surface(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)
smooth = SettingsQuality()
mesh = MeshBrep(Brep=S, Settings=smooth)
medges = MeshEdges(Mesh=mesh)  # -> NakedEdges, InteriorEdges, NonManifoldEdges
mesh_uv = MeshSurface(Surface=S, UCount=Slider(24, range=0..100), VCount=Slider(16, range=0..100), Overhang=True, Equalize=False)

# ----
inside = CurvesA(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)
outside = CurvesB(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)

# ---- group: minimalSurface
mesh_2 = Mesh([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])
mjoin = MeshJoin(Meshes=mesh_2)
weld = WeldMesh(Mesh=mjoin, Angle=3.141592654)
weldvertices = MeshWeldVertices(Mesh=weld, Tolerance=0.01)  # -> RuntimeMessage, Mesh
unifynormals = MeshUnifyNormals(Mesh=weldvertices.Mesh)
nv = NakedVertices(Mesh=unifynormals)  # -> ClothedIndex, NakedIndex, ClothedPts, NakedPts
mesh_3 = Mesh(unifynormals)
fixed = Integer(nv.NakedIndex)

# ----
selectionregions = Curve([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])
mesh_4 = Mesh(mesh_uv)
mesh_input = GhPythonScript(M=mesh_4)  # -> out, v, e, f; inputs M: Mesh
# ---------- mesh_input: Python ----------
__author__ = "pnourian"
__version__ = "2020.08.21"

import rhinoscriptsyntax as rs
import Rhino.Geometry as rg
import math
#####################################
#input validation: weldedness, manifoldness, cleanness
#####################################
if not M.IsManifold(True):
    raise Exception("the input mesh is non-mannifold and this method is not designed to work with non-manifold meshes!")
M.Weld(math.pi)
M.Vertices.CombineIdentical(True,True)
M.Vertices.CullUnused()
if not M.Vertices.Count==M.TopologyVertices.Count:
    raise Exception("the input mesh must be completely welded; although we tried our best, the given mesh seems to have a problem not allowing it to be fully welded!")
#####################################
#exporting vertices as a list of rg.Point3f
#####################################
v=M.Vertices.ToPoint3fArray()
#####################################
#exporting edges as a list of tuples
#####################################
edges=[]
for edgeIndex in range(M.TopologyEdges.Count):
    IJ=M.TopologyEdges.GetTopologyVertices(edgeIndex)
    edges.append((IJ.I,IJ.J))
e=edges
#####################################
#exporting faces as a list of tuples
#####################################
faces=[]
if M.Faces.QuadCount==M.Faces.Count:
    print("a fully quadrilateral mesh")
    for face in M.Faces:
        faces.append((face.A,face.B,face.C,face.D))
elif M.Faces.TriangleCount==M.Faces.Count:
    print("a fully triangular mesh")
    for face in M.Faces:
        faces.append((face.A,face.B,face.C))
else:
    raise Exception("this method only works for meshes that are either fully quadrilateral or fully triangular!")

f=faces
# ---------- end mesh_input ----------
P = Point(mesh_input.v)
points_in_a_band = GhPythonScript(v=P, selectionCurves=selectionregions)  # -> out, inBandVertices, inBandIndices; inputs v: list of Point3d, selectionCurves: list of Curve
# ---------- points_in_a_band: Python ----------
__author__ = "pnourian"
__version__ = "2020.08.21"

import rhinoscriptsyntax as rs
import Rhino.Geometry as rg
tolerance=10E-3
chosenVertices=[]
chosenIndices=[]
for i in range(v.Count):#vertex in v:
    vertex=v[i]
    chosen=False
    for j in range(selectionCurves.Count):
        insideInside=(selectionCurves[j].Contains(vertex, rg.Plane.WorldXY,tolerance)==rg.PointContainment.Inside)
        chosen=chosen or insideInside
    if chosen:
        chosenVertices.append(vertex)
        chosenIndices.append(i)
inBandVertices=chosenVertices
inBandIndices=chosenIndices
# ---------- end points_in_a_band ----------
points_in_a_band_2 = GhPythonScript(v=P, inside=inside, outside=outside)  # -> out, inBandVertices, inBandIndices; inputs v: list of Point3d, inside: Curve, outside: Curve
# ---------- points_in_a_band_2: Python ----------
__author__ = "pnourian"
__version__ = "2020.08.21"

import rhinoscriptsyntax as rs
import Rhino.Geometry as rg
tolerance=10E-3
chosenVertices=[]
chosenIndices=[]
for i in range(v.Count):#vertex in v:
    vertex=v[i]
    insideInside=(inside.Contains(vertex, rg.Plane.WorldXY,tolerance)==rg.PointContainment.Inside)
    outsideOutside=(outside.Contains(vertex, rg.Plane.WorldXY,tolerance)==rg.PointContainment.Outside)
    chosen=insideInside and outsideOutside
    if chosen:
        chosenVertices.append(vertex)
        chosenIndices.append(i)
inBandVertices=chosenVertices
inBandIndices=chosenIndices
# ---------- end points_in_a_band_2 ----------
points_in_a_band_3 = Points_in_a_Band(v=P, inside=inside, outside=outside)  # -> inbandvertices_2, inbandindices_2
border = GhPythonScript(M=mesh_4)  # -> out, a; inputs M: Mesh
# ---------- border: Python ----------
borders=M.GetNakedEdges()
CurveBorders=[]
for border in borders:
    CurveBorders.append(border.ToNurbsCurve())
a=CurveBorders
# ---------- end border ----------
crv = Curve(border.a)
python = GhPythonScript(v=mesh_input.v, guideCrv=crv)  # -> out, Indices, Vertices; inputs v: list of Point3d, guideCrv: Curve
# ---------- python: Python ----------
__author__ = "pnourian"
__version__ = "2020.08.21"

import rhinoscriptsyntax as rs
#import clr
#import System
import Rhino.Geometry as rg
maxDistance=10E6
minDistance=10E-6
CloseVertices=[]
CloseIndices=[]
for i in range(v.Count):
    vertex=v[i]
    #t=clr.References[System.Double]()#https://developer.rhino3d.com/guides/rhinopython/python-reference/
    CP=guideCrv.ClosestPoint(vertex,maxDistance)
    #print(CP) how to deal with 'out' (output) parameters and 'ref'(by reference) parameters: IronPython will return the output of such methods as tuples including these parameters! Note that we skipped the argument t in the signature of the function altogether!
    closestPoint=guideCrv.PointAt(CP[1])
    distance=closestPoint.DistanceTo(vertex)
    if distance<minDistance:
        CloseIndices.append(i)
        CloseVertices.append(vertex)
Indices=CloseIndices
Vertices=CloseVertices
# ---------- end python ----------
dots = DotDisplay(Point=python.Vertices, Colour=RGB(0, 0, 0), Size=1)
pipe = Pipe(Curve=border.a, Radius=1, Caps=0)
dots_2 = DotDisplay(Point=points_in_a_band.inBandVertices, Colour=RGB(0, 0, 0), Size=1)
mesh_5 = Mesh(mesh_3)
number_slider = Slider(10, range=0..100)
number_slider_2 = Slider(100, range=0..1000)
number_slider_3 = Slider(25, range=0..100)
number_slider_4 = Slider(0.05, range=0..1)
number_slider_5 = Slider(2, range=0..10)
mesh_input_2 = GhPythonScript(M=mesh_5)  # -> out, v, e, f; inputs M: Mesh; same code as mesh_input
number_slider_6 = Slider(0.2, range=0..1)
weightload = WeightLoad(mass=Slider(4, range=0..10), v=mesh_input.v)
toggle = BooleanToggle(False)
gh_cpython = GH_CPython(input=Slider(1, range=0..1))  # -> output; inputs input: list; unedited script template
weightload_2 = WeightLoad(mass=Slider(4, range=0..10), v=mesh_input_2.v)
button = Button()
dynamicrelaxation_cpython = GH_CPython(
    input=button,
    v=mesh_input.v,
    e=mesh_input.e,
    f=mesh_input.f,
    justRelax=toggle,
    contraction=number_slider_6,
    fixed=points_in_a_band.inBandIndices,
    damp=number_slider,
    IterCount=number_slider_2,
    Elasticity=number_slider_3,
    timeInterval=number_slider_4,
    vertexMass=number_slider_5)  # -> output, a, b, c, X, Y, Z; inputs input: list, v: list, e: list, f: list, justRelax: list, externalLoad: list, contraction: list, fixed: list, damp: list, IterCount: list, Elasticity: list, timeInterval: list, vertexMass: list
#   port input: [required] - [type = int] - [default = None] Descripe your input here * bullet point. * bullet point
#   port output: indicate your output description here. refers to a new line.
# ---------- dynamicrelaxation_cpython: Python ----------
########################
#Dynamic Relaxation, by Pirouz Nourian & Shervin Azadi, last edited on 22-08-2020
#Licence and citation information on https://zenodo.org/record/3459223#.X0FG58gzZPY
########################
# Dynamic relaxation
### Input data:
# vertices: a list of unique xyz coordinates
# edges: a list of pairs of vertex indices
# points: index list of fixed vertices
### Output data:
# xyzFS : Final state of the system
import numpy as np
verts=np.array(v)
edges=np.array(e)
faces=np.array(f)# unused for the moment, however in principle faces as 2D elements can ave elasticity as well. Right now, weare simiulating this mesh as a fishnet, as if it doesn't have faces!
#####################
#advanced setting parameters
#####################
c = damp# adamp : Acceleration damp controls the stability of the system
MaximumIterations = IterCount
k = Elasticity# K : Elasticity Constant in Hooke's law
dt = timeInterval# dt : Time intervals
m = vertexMass

vertexCount = len(verts)
edgeCount = len(edges)
freeIndices = list(set(range(vertexCount)) - set(fixed))#indices of free points
xyz = np.copy(verts)
p=np.zeros((vertexCount, 3), dtype=np.float64)
p=np.array(externalLoad)

if externalLoad==None and not justRelax:
    p=np.tile(np.multiply(m,np.array([0,0,9.81])),(vertexCount,1))
elif justRelax:
    p=np.zeros((vertexCount, 3), dtype=np.float64)
if((not p.shape[0]==vertexCount)):
    raise Exception('the length of the list of external loads is not the same as the list of vertices!')

# v : Velosity
v = np.zeros((vertexCount, 3), dtype=np.float64)
# restlength : Rest Length of the springs
edgeVectors = xyz[edges[:,1]] - xyz[edges[:,0]]#np.array([(xyz[edges[i][1]] - xyz[edges[i][0]]) for i in range(edgeCount)])
restlength = np.linalg.norm(edgeVectors,axis=1,keepdims=True)#np.array([np.sqrt(diff[i,0]*diff[i,0] + diff[i,1]*diff[i,1] + diff[i,2]*diff[i,2]) for i in range(edgeCount)])
if(justRelax):
    restlength=np.multiply(contraction,restlength)
###################
#the main loop, must be changed to a while loop but for now this is ok
###################
#xyz0 = xyz.copy()# xyz0 : Initial Position
differance=1
tolerance=10E-3
t=0
while((differance>tolerance)and t<=MaximumIterations):#for t in range(MaximumIterations):

    R = np.zeros((vertexCount, 3), dtype=np.float64)# R : Final Forces
    vp = v.copy()# vp : Initial Velocity
    xyz0 = xyz.copy()#previous positions

    edgeVectors_t = xyz[edges[:,1]] - xyz[edges[:,0]]
    edgeLengths_t = (np.linalg.norm(edgeVectors_t,axis=1,keepdims=True))
    EdgeForce = ((edgeLengths_t - restlength) * k)#.reshape((edgeCount,1))# f_{i,j} at the iteration time t, note that this is only the magnitude of these forces, i.e. |f_{i,j}=k\Delta l|  
    EdgeForceVectors = np.multiply(EdgeForce,np.divide(edgeVectors_t,edgeLengths_t))#EdgeForce*(edgeVectors_t/edgeLengths_t)
    
    graph_force = np.zeros((vertexCount,vertexCount, 3))
    graph_force[edges[:,0],edges[:,1]] += EdgeForceVectors

    # S : Sum of Stiffness Force on vertices
    S = np.sum(graph_force, axis=0) - np.sum(graph_force, axis=1)
    R[freeIndices] = p[freeIndices] - S[freeIndices]
    
    A = 1/(1 + c * dt * 0.5)
    B = (1 - c * dt * 0.5 ) / (1 + c * dt * 0.5)
    v[freeIndices] = A * dt * R[freeIndices] / m + B * vp[freeIndices]# updating the velocity
    xyz[freeIndices] = xyz0[freeIndices] + dt * v[freeIndices]# updating the position
    differance=np.linalg.norm(xyz-xyz0,'fro')

    t+=1

print(t)
print(differance)

X=xyz[:,0].tolist()
Y=xyz[:,1].tolist()
Z=xyz[:,2].tolist()
# ---------- end dynamicrelaxation_cpython ----------
dynamicrelaxation_cpython_2 = GH_CPython(
    input=button,
    v=mesh_input.v,
    e=mesh_input.e,
    f=mesh_input.f,
    justRelax=toggle,
    contraction=number_slider_6,
    fixed=points_in_a_band.inBandIndices,
    damp=number_slider,
    IterCount=number_slider_2,
    Elasticity=number_slider_3,
    timeInterval=number_slider_4,
    vertexMass=number_slider_5)  # -> output, a, b, c, X, Y, Z; inputs input: list, v: list, e: list, f: list, justRelax: list, externalLoad: list, contraction: list, fixed: list, damp: list, IterCount: list, Elasticity: list, timeInterval: list, vertexMass: list
#   port input: [required] - [type = int] - [default = None] Descripe your input here * bullet point. * bullet point
#   port output: indicate your output description here. refers to a new line.
# ---------- dynamicrelaxation_cpython_2: Python ----------
########################
#Dynamic Relaxation, by Pirouz Nourian & Shervin Azadi, last edited on 22-08-2020
#Licence and citation information on https://zenodo.org/record/3459223#.X0FG58gzZPY
########################
# Dynamic relaxation
### Input data:
# vertices: a list of unique xyz coordinates
# edges: a list of pairs of vertex indices
# points: index list of fixed vertices
### Output data:
# xyzFS : Final state of the system
import numpy as np
verts=np.array(v)
edges=np.array(e)
faces=np.array(f)# unused for the moment, however in principle faces as 2D elements can ave elasticity as well. Right now, weare simiulating this mesh as a fishnet, as if it doesn't have faces!
#####################
#advanced setting parameters
#####################
c = damp# adamp : Acceleration damp controls the stability of the system
MaximumIterations = IterCount
k = Elasticity# K : Elasticity Constant in Hooke's law
dt = timeInterval# dt : Time intervals
m = vertexMass

vertexCount = len(verts)
edgeCount = len(edges)
freeIndices = list(set(range(vertexCount)) - set(fixed))#indices of free points
xyz = np.copy(verts)
p=np.zeros((vertexCount, 3), dtype=np.float64)
p=np.array(externalLoad)
if externalLoad==None and not justRelax:
    p=np.tile(np.multiply(m,np.array([0,0,9.81])),(vertexCount,1))
elif justRelax:
    p=np.zeros((vertexCount, 3), dtype=np.float64)
if((not p.shape[0]==vertexCount)):
    raise Exception('the length of the list of external loads is not the same as the list of vertices!')
#p = np.zeros((vertexCount, 3), dtype=np.float64)# p : Applied external/lateral Load Component which in our case is zero
# W : Gravity Force
#W = np.tile(np.array([0,0,9.81]),(vertexCount,1))#np.array([np.array([0,0,9.81]) for i in range(vertexCount)])
# v : Velosity
v = np.zeros((vertexCount, 3), dtype=np.float64)
# restlength : Rest Length of the springs
edgeVectors = xyz[edges[:,1]] - xyz[edges[:,0]]#np.array([(xyz[edges[i][1]] - xyz[edges[i][0]]) for i in range(edgeCount)])
restlength = np.linalg.norm(edgeVectors,axis=1,keepdims=True)#np.array([np.sqrt(diff[i,0]*diff[i,0] + diff[i,1]*diff[i,1] + diff[i,2]*diff[i,2]) for i in range(edgeCount)])
if(justRelax):
    restlength=np.multiply(contraction,restlength)
###################
#the main loop, must be changed to a while loop but for now this is ok
###################
#xyz0 = xyz.copy()# xyz0 : Initial Position
differance=1
tolerance=10E-3
t=0
while((differance>tolerance)and t<=MaximumIterations):#for t in range(MaximumIterations):
    S = np.zeros((vertexCount, 3), dtype=np.float64)# S : Sum of Stiffness Force on vertices
    R = np.zeros((vertexCount, 3), dtype=np.float64)# R : Final Forces
    vp = v.copy()# vp : Initial Velocity
    edgeVectors_t = xyz[edges[:,1]] - xyz[edges[:,0]]
    edgeLengths_t = (np.linalg.norm(edgeVectors_t,axis=1,keepdims=True))
    EdgeForce = ((edgeLengths_t - restlength) * k)#.reshape((edgeCount,1))# f_{i,j} at the iteration time t, note that this is only the magnitude of these forces, i.e. |f_{i,j}=k\Delta l|  
    EdgeForceVectors=np.multiply(EdgeForce,np.divide(edgeVectors_t,edgeLengths_t))#EdgeForce*(edgeVectors_t/edgeLengths_t)
    xyz0 = xyz.copy()#previous positions
    for e in range(edgeCount):# iterating throughout the edges, adding the force of each edge to the coresponding nodes     
        S[edges[e,0]] -= EdgeForceVectors[e]
        S[edges[e,1]] += EdgeForceVectors[e]
    R[freeIndices] = p[freeIndices] - S[freeIndices]
    A = 1/(1 + c * dt * 0.5)
    B = (1 - c * dt * 0.5 ) / (1 + c * dt * 0.5)
    v[freeIndices] = A * dt * R[freeIndices] / m + B * vp[freeIndices]# updating the velocity
    xyz[freeIndices] = xyz0[freeIndices] + dt * v[freeIndices]# updating the position
    differance=np.linalg.norm(xyz-xyz0,'fro')
    #print(differance)
    t+=1
print(t)
print(differance)
X=xyz[:,0].tolist()
Y=xyz[:,1].tolist()
Z=xyz[:,2].tolist()
# ---------- end dynamicrelaxation_cpython_2 ----------
dynamicrelaxation_cpython_3 = GH_CPython(
    input=Button(),
    v=mesh_input_2.v,
    e=mesh_input_2.e,
    f=mesh_input_2.f,
    justRelax=Toggle(True),
    contraction=Slider(0.2, range=0..1),
    fixed=fixed,
    damp=Slider(10, range=0..100),
    IterCount=Slider(250, range=0..1000),
    Elasticity=Slider(25, range=0..100),
    timeInterval=Slider(0.05, range=0..1),
    vertexMass=Slider(2, range=0..10))  # -> output, a, b, c, X, Y, Z; inputs input: list, v: list, e: list, f: list, justRelax: list, externalLoad: list, contraction: list, fixed: list, damp: list, IterCount: list, Elasticity: list, timeInterval: list, vertexMass: list; same code as dynamicrelaxation_cpython_2
pt = ConstructPoint(
    XCoordinate=dynamicrelaxation_cpython.X,
    YCoordinate=dynamicrelaxation_cpython.Y,
    ZCoordinate=dynamicrelaxation_cpython.Z)
pt_2 = ConstructPoint(
    XCoordinate=dynamicrelaxation_cpython_2.X,
    YCoordinate=dynamicrelaxation_cpython_2.Y,
    ZCoordinate=dynamicrelaxation_cpython_2.Z)
pt_3 = ConstructPoint(
    XCoordinate=dynamicrelaxation_cpython_3.X,
    YCoordinate=dynamicrelaxation_cpython_3.Y,
    ZCoordinate=dynamicrelaxation_cpython_3.Z)
reconstructmesh = GhPythonScript(v=pt_3, f=mesh_input_2.f)  # -> out, a; inputs v: list of Point3d, f: list
# ---------- reconstructmesh: Python ----------
__author__ = "pnourian"
__version__ = "2020.08.21"

import Rhino.Geometry as rg
import System
m=rg.Mesh()
for faceTuple in f:
    if len(faceTuple)==4:
        m.Faces.AddFace(faceTuple[0],faceTuple[1],faceTuple[2],faceTuple[3])
    elif len(faceTuple)==3:
        m.Faces.AddFace(faceTuple[0],faceTuple[1],faceTuple[2])
IEV=System.Array[rg.Point3f](v)
m.Vertices.AddVertices(IEV)
a=m
# ---------- end reconstructmesh ----------
reconstructmesh_2 = GhPythonScript(v=pt, f=mesh_input.f)  # -> out, a; inputs v: list of Point3d, f: list; same code as reconstructmesh
wbcatmullclark = WeaverbirdsCatmullClarkSubdivision(MeshCurves=reconstructmesh.a, Level=3, SmoothNakedEdges=0)
reconstructmesh_3 = GhPythonScript(v=pt_2, f=mesh_input.f)  # -> out, a; inputs v: list of Point3d, f: list; same code as reconstructmesh
wbcatmullclark_2 = WeaverbirdsCatmullClarkSubdivision(MeshCurves=reconstructmesh_2.a, Level=3, SmoothNakedEdges=0)
wbcatmullclark_3 = WeaverbirdsCatmullClarkSubdivision(MeshCurves=reconstructmesh_3.a, Level=3, SmoothNakedEdges=0)

# ==== cluster Points_in_a_Band
v = ClusterInput()
inside = ClusterInput()
outside = ClusterInput()
outside_2 = CurvesB(outside)
inside_2 = CurvesA(inside)
v_2 = Point(v)
incurve = PointInCurve(Point=v_2, Curve=outside_2)  # -> Relationship, Point
incurve_2 = PointInCurve(Point=v_2, Curve=inside_2)  # -> Relationship, Point
lng = ListLength(List=v_2)
equals = Equality(FirstNumber=incurve_2.Relationship, SecondNumber=2)  # -> Equality, Inequality
equals_2 = Equality(FirstNumber=incurve.Relationship, SecondNumber=0)  # -> Equality, Inequality
and = GateAnd(A=equals.Equality, B=equals_2.Equality)
series = Series(Start=0, Step=1, Count=lng)
panel = Panel(equals.Equality)
cull = CullPattern(List=v_2, CullPattern=and)
cull_2 = CullPattern(List=series, CullPattern=and)
inbandvertices = Point(cull)
inbandindices = Integer(cull_2)
inbandvertices_2 = ClusterOutput(inbandvertices)
inbandindices_2 = ClusterOutput(inbandindices)

# ==== cluster WeightLoad
mass = ClusterInput()
v = ClusterInput()
mass_2 = Number(mass)
v_2 = Point(v)
multiplication = Multiplication(A=mass_2, B="{0.0,0.0,9.81]")
lng = ListLength(List=v_2)
repeat = RepeatData(Data=multiplication, Length=lng)
weightload = Vector(repeat)
weightload_2 = ClusterOutput(weightload)
